# Grasshopper definition tester.ghx (Grasshopper 1.0.7)
# plug-ins: Human

trigger = Trigger(Interval=-1000, TimerInterval=1000, Target=ghpython_script)
boolean_toggle = BooleanToggle(False)
ghpython_script = GhPythonScript(reset=Button())  # -> count
# ---------- ghpython_script: Python ----------
import Grasshopper.Kernel as gh
import scriptcontext as sc

# Define a unique key for the counter in the Grasshopper document's sticky dictionary
counter_key = 'ghpython_counter'

# Check if the counter exists in the sticky dictionary
if counter_key not in sc.sticky or reset:
    # Increment the counter by one
    sc.sticky[counter_key] = -1
else:
    # Initialize the counter if it doesn't exist
    sc.sticky[counter_key] += 1

# Output the current value of the counter
counter = sc.sticky[counter_key]

# Set the output
count = counter
# ---------- end ghpython_script ----------
panel = Panel(ghpython_script)
ghpython_script_2 = GhPythonScript(index=Slider(21, range=0..100), write=Button())  # -> log, box, rg, text_frame, text_text, ref, lines; inputs index: Int32
# ---------- ghpython_script_2: Python ----------
from writehops import HOPSWriter, FrenchRidgeProcess, DoubleCutProcess, TextProcess
from parse_btlx import BTLXParser
from compas_rhino import unload_modules
import math
from compas_rhino.conversions import frame_to_rhino, point_to_rhino, line_to_rhino

from compas.geometry import Transformation, Frame, Point, Plane, Rotation, angle_vectors_signed, Vector, angle_vectors
from compas.geometry import Box, Line

import Rhino.Geometry as rg
import os

from copy import deepcopy

unload_modules("writehops")
unload_modules("parse_btlx")

file_path = os.path.join(os.path.dirname(ghenv.Component.OnPingDocument().FilePath), "Module_44_test.btlx")
parser = BTLXParser(file_path)
remachining_dict = parser.get_remachining_dict()
text_dict = parser.get_text_dict()

keys = [key for key, value in remachining_dict.items()]

index = keys[index]
log = str(index) + " of %s" % str(len(keys)) + " pieces"
#print index
#print(remachining_dict)
length = remachining_dict[str(index)]["length"]
print length
hopper = HOPSWriter(length)
processes = []
geo = []
box = Box.from_corner_corner_height([0,0,0], [length, 60,0], 60)
print remachining_dict[str(index)]
text =  text_dict[str(index)]["text"][0]
for machining in remachining_dict[str(index)]["machinings"]:
    if machining["Name"] == "French ridge lap":
        process = FrenchRidgeProcess(hopper, machining["face_front"], machining["ReferencePlaneID"])
        p = "frl"
    elif machining["Name"] == "T-Butt Joint":
        p = "dc"
        process = DoubleCutProcess(hopper, machining)
    print process.ref_orientation
#    print process.
    text_process = TextProcess(process.hopper, text, process.ref_orientation)
    text_frame = frame_to_rhino(text_process.frame)
    text_text = text_process.text
    ref =frame_to_rhino(text_process.ref_frame)
    processes.append(process)
    if p == "dc":
        geo.extend([process.cf1, process.cf2])
        lines = line_to_rhino(Line(*process.pts))
    else:
        geo.extend([process.frame1, process.frame2])
hopper.generate_hops(processes)

rg = []
for f in geo:
    if isinstance(f, Frame):
        rg.append(frame_to_rhino(f))
    else:
        for frame in f:
            rg.append(frame_to_rhino(frame))
#create folder with btlx name
filename = os.path.join(os.path.dirname(ghenv.Component.OnPingDocument().FilePath),"hops", "%s_.hop" % str(index))
if write:
    hopper.write_to_file(file_path=filename)
# ---------- end ghpython_script_2 ----------
panel_2 = Panel(ghpython_script_2.log)
plane = Plane(ghpython_script_2.rg)
plane_2 = Plane(ghpython_script_2.ref)
custom_preview_lineweights = CustomPreviewLineweights(
    Geometry=ghpython_script_2.lines,
    Shader=ColourSwatch(SwatchColor=RGB(0, 255, 195)),
    Thickness=Slider(10, range=0..10),
    Absolute=False)
draw = Draw(cg=ghpython_script_2.box)  # -> rg
#   port cg: The COMPAS geometry or datastructure to be drawn.
#   port rg: The Rhino geometry object.
# ---------- draw: Python ----------
"""
Draws COMPAS geometry in Grasshopper.
"""
from ghpythonlib.componentbase import executingcomponent as component

from compas.scene import SceneObject


class CompasToRhinoGeometry(component):
    def RunScript(self, cg):
        if not cg:
            return None

        return SceneObject(cg).draw()
# ---------- end draw ----------
brep_plane = BrepPlane(Brep=draw, Plane=plane)  # -> Curves, Points
text_tag_3d = TextTag3D(Location=ghpython_script_2.text_frame, Text=ghpython_script_2.text_text, Size=Slider(20, range=0..100), Justification=7)
custom_preview_lineweights_2 = CustomPreviewLineweights(
    Geometry=brep_plane.Curves,
    Shader=graft([ColourSwatch(SwatchColor=RGB(234, 255, 0)), ColourSwatch(SwatchColor=RGB(0, 102, 255))]),
    Thickness=Slider(3.3, range=0..10),
    Absolute=False)
